# Grasshopper definition metarpillar.gh (Grasshopper 1.0.7)

number_slider = Slider(19, range=0..100)
X = Slider(20, range=0..30)
Y = Slider(5, range=0..10)
number_slider_2 = Slider(5, range=0..100)
cir = Circle(Plane=PlaneXY(0, 0, 0), Radius=Slider(2, range=0..10))
pt = Point(Point(0, 0, 0))
rectangle = Rectangle(Plane=pt, XSize=number_slider_2, YSize=number_slider_2, Radius=0)  # -> Rectangle, Length
subtraction = Subtraction(A=X, B=1)
subtraction_2 = Subtraction(A=Y, B=1)
multiplication = Multiplication(A=number_slider_2, B=subtraction)
multiplication_2 = Multiplication(A=number_slider_2, B=subtraction_2)
arrrec = RectangularArray(Geometry=cir, Cell=rectangle.Rectangle, XCount=X, YCount=Y)  # -> Geometry, Transform
panel = Panel(arrrec.Geometry)
rectangle_2 = Rectangle(Plane=pt, XSize=multiplication, YSize=multiplication_2, Radius=0)  # -> Rectangle, Length
disc = Discontinuity(Curve=rectangle_2.Rectangle, Level=1)  # -> Points, Parameters
item = ListItem(List=disc.Points, Index=Slider(3, range=0..10), Wrap=True)
vec = VectorXYZ(XComponent=Slider(0, range=0..100), YComponent=Slider(0, range=0..100), ZComponent=number_slider)  # -> Vector, Length
Z = UnitZ(Factor=Slider(-1, range=-1..0))
rectangle_3 = Rectangle(Plane=item, XSize=multiplication, YSize=[Slider(0, range=0..10), Slider(-2, range=-3..0)], Radius=0)  # -> Rectangle, Length
extr = Extrude(Base=rectangle_2.Rectangle, Direction=vec.Vector)
extr_2 = Extrude(Base=arrrec.Geometry, Direction=vec.Vector)
cap = CapHoles(Brep=extr_2)
cap_2 = CapHoles(Brep=extr)
extr_3 = Extrude(Base=rectangle_3.Rectangle, Direction=vec.Vector)
sdiff = SolidDifference(BrepsA=cap_2, BrepsB=cap)
cap_3 = CapHoles(Brep=extr_3)

# ---- group: METARPILLAR}
sunion = SolidUnion(Breps=[sdiff, cap_3])

# ----
bbox = BoundingBox(Content=sunion, Plane=PlaneXY(0, 0, 0))  # -> Box, Box_2
extr_4 = Extrude(Base=rectangle_2.Rectangle, Direction=Z)
sunion_2 = SolidUnion(Breps=[extr_4, bbox.Box])
cap_4 = CapHoles(Brep=extr_4)
sdiff_2 = SolidDifference(BrepsA=bbox.Box, BrepsB=sunion)
debrep = DeconstructBrep(Brep=cap_4)  # -> Faces, Edges, Vertices
item_2 = ListItem(List=debrep.Vertices, Index=Slider(1, range=0..10), Wrap=True)
addition = Addition(A=number_slider, B=1)
rectangle_4 = Rectangle(Plane=item_2, XSize=multiplication, YSize=multiplication_2, Radius=0)  # -> Rectangle, Length
Z_2 = UnitZ(Factor=addition)
extr_5 = Extrude(Base=rectangle_4.Rectangle, Direction=Z_2)
debrep_2 = DeconstructBrep(Brep=extr_5)  # -> Faces, Edges, Vertices
item_3 = ListItem(List=debrep_2.Faces, Index=Slider(6, range=0..10), Wrap=True)
item_4 = ListItem(List=debrep_2.Faces, Index=Slider(4, range=0..10), Wrap=True)
item_5 = ListItem(List=debrep_2.Faces, Index=Slider(7, range=0..10), Wrap=True)
item_6 = ListItem(List=debrep_2.Faces, Index=Slider(9, range=0..10), Wrap=True)
Y_2 = UnitY(Factor=1)
Y_3 = UnitY(Factor=-1)
X_2 = UnitX(Factor=1)
extr_6 = Extrude(Base=item_3, Direction=X_2)
X_3 = UnitX(Factor=-1)
extr_7 = Extrude(Base=item_4, Direction=X_3)
extr_8 = Extrude(Base=item_5, Direction=Y_2)
extr_9 = Extrude(Base=item_6, Direction=Y_3)

# ---- group: MOLDE
sunion_3 = SolidUnion(Breps=[sdiff_2, cap_4])
merge = Merge(Data1=extr_6, Data2=extr_7, Data3=extr_8, Data4=extr_9)
